# Grasshopper definition ayam_lepas_test_1.gh (Grasshopper 1.0.7)

global_sphere_radius = Slider(2000, range=2000..70000)
yaw = Slider(0, range=-180..180)
global_sphere_vertical_div = Slider(9, range=3..20)
global_sphere_horizontal_div = Slider(16, range=0..40)
small_panel_width = Slider(0.572, range=0..1)
roll = Slider(0, range=-180..180)
pitch = Slider(0, range=-180..180)
small_panel_height = Slider(0.567, range=0..1)
pi = Pi(Factor=".5")
construct_domain = ConstructDomain(DomainStart=expr("x*-1", pi), DomainEnd=pi)
multiplication = Multiplication(A=global_sphere_radius, B="0 to 1")
range = Range(Domain=multiplication, Steps=global_sphere_vertical_div)
range_2 = Range(Domain=construct_domain, Steps=global_sphere_vertical_div)
cosine = Cosine(Value=range_2)
sine = Sine(Value=range_2)
multiplication_2 = Multiplication(A=global_sphere_radius, B=sine)
multiplication_3 = Multiplication(A=global_sphere_radius, B=cosine)
construct_point = ConstructPoint(XCoordinate=0, YCoordinate=0, ZCoordinate=multiplication_2)
circle = Circle(Plane=construct_point, Radius=multiplication_3)
panel = Panel(multiplication_3)
construct_domain_2 = ConstructDomain(DomainStart="1", DomainEnd=expr("x-1", global_sphere_vertical_div))
sub_list = SubList(List=circle, Domain=construct_domain_2, Wrap=True)  # -> flatten(List), Index
point = Point(Point(0, 0, 0))
yaw_2 = Rotate(Geometry=sub_list.List, Angle=degrees(yaw), Plane=point)  # -> Geometry, Transform
yz_plane = YZPlane(Origin=Point(0, 0, 0))
xz_plane = XZPlane(Origin=Point(0, 0, 0))
roll_2 = Rotate(Geometry=yaw_2.Geometry, Angle=degrees(roll), Plane=yz_plane)  # -> Geometry, Transform
roll_3 = Rotate(Geometry=roll_2.Geometry, Angle=degrees(pitch), Plane=xz_plane)  # -> Geometry, Transform
perp_frames = PerpFrames(Curve=roll_3.Geometry, Count=global_sphere_horizontal_div, Align=True)  # -> Frames, Parameters
deconstruct_plane = DeconstructPlane(Plane=perp_frames.Frames)  # -> Origin, XAxis, YAxis, ZAxis
construct_plane = ConstructPlane(Origin=deconstruct_plane.Origin, XAxis=deconstruct_plane.ZAxis, YAxis=deconstruct_plane.YAxis)
shift_list = ShiftList(List=construct_plane, Shift="-1", Wrap="0")
shift_list_2 = ShiftList(List=construct_plane, Shift="1", Wrap="0")
line = Line(StartPoint=shift_list_2, EndPoint=shift_list)
length = Length(Curve=line)
list_item = ListItem(List=length, Index=0, Wrap=True)
shift_list_3 = ShiftList(List=construct_point, Shift="-1", Wrap="0")
shift_list_4 = ShiftList(List=construct_point, Shift="1", Wrap="0")
distance = Distance(PointA=shift_list_4, PointB=shift_list_3)
trim_tree = TrimTree(Tree=list_item, Depth="1")
division = Division(A=trim_tree, B=2)
split_list = SplitList(List=distance, Index="1")  # -> ListA, flatten(ListB)
graft_tree = GraftTree(Tree=split_list.ListB, IncludeEmptyLists=True, IncludeNullItems=True)
construct_domain_3 = ConstructDomain(DomainStart=0, DomainEnd=division)
division_2 = Division(A=graft_tree, B="2")
panel_2 = Panel(division)
panel_3 = Panel(trim_tree)
remap_numbers = RemapNumbers(Value=small_panel_height, Source="0 to 1", Target=construct_domain_3)  # -> Mapped, Clipped
construct_domain_4 = ConstructDomain(DomainStart="0", DomainEnd=division_2)
remap_numbers_2 = RemapNumbers(Value=small_panel_width, Source="0 to 1", Target=construct_domain_4)  # -> Mapped, Clipped
construct_domain_5 = ConstructDomain(DomainStart=expr("x * -1", remap_numbers.Mapped), DomainEnd=remap_numbers.Mapped)
construct_domain_6 = ConstructDomain(DomainStart=expr("x * -1", remap_numbers_2.Mapped), DomainEnd=remap_numbers_2.Mapped)
plane_surface = PlaneSurface(Plane=construct_plane, XSize=construct_domain_5, YSize=construct_domain_6)
